vi "ClassifierUI.gvi"   [LabVIEW NXG 2.1.0]
panel controls:
  "Problem Description": string
  "Hardware": string
  "Software": string
  "Classify?": bool
  "stop": bool
panel indicators:
  "Type": string
uses:
  NI::G Core::Libraries and Executables::System Exec.gvi
diagram:
  while {
    event {
      on "Classify?" Mouse up {
        Concatenate Strings("python RunClassifier.py", " ", "\"", $"Problem Description", "\"", " ", "\"", $Hardware, "\"", " ", "\"", $Software, "\"") -> w2
        call "System Exec.gvi"(run minimized?=TRUE, command line=w2, working directory=path "C:\\Users\\ktovson\\Desktop\\SR Classifier Project") -> (standard output=w3)
        $Type <- w3
        w1 = default
      }
      on "stop" Mouse up {
        w1 = $stop
      }
    }
    stop if w1
  }
